# Grasshopper definition PlotSubjectData.gh (Grasshopper 1.0.7)

# Base point of facades in Unreal
experiment_reference_point = Point(<point referenced from the Rhino model>)
pdecon = Deconstruct(Point=experiment_reference_point)  # -> XComponent, YComponent, ZComponent
concat = Concatenate(FragmentA=pdecon.XComponent, FragmentB=",", FragmentC=pdecon.YComponent, FragmentD=",", FragmentE=pdecon.ZComponent)
# Set True to run
run = BooleanToggle(True)
not = GateNot(A=run)
get_head_data = GhPythonScript(
    run=run,
    data_dir="D:\\Unity\\Retrofitting_Training\\Data\\Subjects\\Mihir",
    subject="11-16-2022_10-47-04_MANUAL",
    experiment_reference_point=concat)  # -> out, gui_test_complete_timestamp, head_positions, head_rotations, wall_visibles, wall_position, wall_rotation, menu_visibles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
# ---------- get_head_data: Python ----------
__author__ = "John"
__version__ = "2022.03.15"

import rhinoscriptsyntax as rs
import Rhino
import csv
import os
from datetime import datetime
import math

datetime_format = '%H:%M:%S.%f'
"""
[
((pos_x,pos_y,pos_z), (rot_x,rot_y,rot_z), (gaze_pos_x, gaze_pos_y, gaze_pos_z), (gaze_rot_x, gaze_rot_y, gaze_rot_z), datetime, should_draw),
((pos_x,pos_y,pos_z), (rot_x,rot_y,rot_z), (gaze_pos_x, gaze_pos_y, gaze_pos_z), (gaze_rot_x, gaze_rot_y, gaze_rot_z), datetime, should_draw),
...
]
"""
# Input values
#head_data = []
#points = []
#head_rotations = []
# Output values
head_positions = []
head_rotations = []
wall_visibles = []
wall_position = None
wall_rotation = None
menu_visibles = []
menu_positions = []
menu_rotations = []
menu_scales = []
# Script values
rs.scriptcontext.doc = rs.Rhino.RhinoDoc.ActiveDoc
experiment_start_timestamp = None
# Column numbers for data files
COL_DATA_TYPE = 0
COL_TASK_NUMBER = 4
COL_TIMESTAMP = 2
COL_HEAD_POS_X = 5
COL_HEAD_POS_Y = 6
COL_HEAD_POS_Z = 7
COL_HEAD_ROT_X = 8
COL_HEAD_ROT_Y = 9
COL_HEAD_ROT_Z = 10
COL_WALL_VISIBLE = 11
COL_WALL_POS_X = 12
COL_WALL_POS_Y = 13
COL_WALL_POS_Z = 14
COL_WALL_ROT_X = 15
COL_WALL_ROT_Y = 16
COL_WALL_ROT_Z = 17
COL_MENU_POS_X = 26
COL_MENU_POS_Y = 27
COL_MENU_POS_Z = 28
COL_MENU_ROT_X = 29
COL_MENU_ROT_Y = 30
COL_MENU_ROT_Z = 31
COL_MENU_SCALE_X = 32
COL_MENU_SCALE_Y = 33
COL_MENU_SCALE_Z = 34
COL_MENU_VISIBLE = 35


def read_timestamp(cell_value):
    data = cell_value.strip()
    # Data
    date = data.split("_")[0]
    month = int(date.split("-")[0])
    day = int(date.split("-")[1])
    year = int(date.split("-")[2])
    # Time
    time = data.split("_")[1]
    hour = int(time.split("-")[0])
    minute = int(time.split("-")[1])
    second = int(time.split("-")[2])
    millisecond = int(time.split("-")[3])
    microsecond = millisecond * 1000
    
    return datetime(year, month, day, hour, minute, second, microsecond)

"""
def tranform_according_to_ref(x, y, z, ref_point, facade_pos):
    x_ref = ref_point[0]
    y_ref = ref_point[1]
    z_ref = ref_point[2]
    facade_x = facade_pos[0]
    facade_y = facade_pos[1]
    facade_z = facade_pos[2]
    # TODO
    return x, y, z
"""

##### MAIN #####
# Get subject data file
if run == True:
    subject_data_file = data_dir + "\\" + subject + ".csv"
    assert os.path.isfile(subject_data_file), "ERROR: File " + subject_data_file + " not found."
    print("Opening " + subject_data_file)
    """
    # Get facade position by reading last row in csv
    with open(subject_data_file) as csvfile:
        reader = csv.reader(csvfile, delimiter=",")
        i = 0
        for row in reader:
            if i == 0:
                i = i + 1
                continue
            if row[WALL_POS_X] != "":
                # Clear old values if necessary to reduce memory usage
                if wall_position != None:
                    wall_position.clear()
                if wall_rotation != None:
                    wall_rotation.clear()
                # Assign new values
                wall_position = [ \
                float(row[COL_WALL_POS_X]),
                float(row[COL_WALL_POS_Y]),
                float(row[COL_WALL_POS_Z])]
                wall_rotation = [ \
                float(row[COL_WALL_ROT_X],
                float(row[COL_WALL_ROT_X],
                float(row[COL_WALL_ROT_X])]
            i = i + 1
    """
    # Read subject data
    with open(subject_data_file) as csvfile:
        reader = csv.reader(csvfile, delimiter=",")
        for row in reader:
            type = row[COL_DATA_TYPE]
            if type=="Task_Started" and (row[COL_TASK_NUMBER].strip() == "1a"):
                experiment_start_timestamp = read_timestamp(row[COL_TIMESTAMP])
            if type == "Head":
                ## Timestamp
                timestamp = read_timestamp(row[COL_TIMESTAMP])
                ## Determine if experiment had started
                experiment_started = True
                if experiment_start_timestamp == None or timestamp <= experiment_start_timestamp:
                    experiment_started = False
                    continue
                ## Head position
                head_pos_x = float(row[COL_HEAD_POS_X])
                head_pos_y = float(row[COL_HEAD_POS_Y])
                head_pos_z = float(row[COL_HEAD_POS_Z])
                head_positions.append(Rhino.Geometry.Point3d(head_pos_x, head_pos_z, head_pos_y))
                ## Head rotation
                head_rot_x = float(row[COL_HEAD_ROT_X])
                head_rot_y = float(row[COL_HEAD_ROT_Y])
                head_rot_z = float(row[COL_HEAD_ROT_Z])
                head_rotations.append(Rhino.Geometry.Point3d(head_rot_x, head_rot_z, head_rot_y))
                ## Wall visible
                wall_visibles.append((row[COL_WALL_VISIBLE].upper().strip() == "TRUE"))
                ## Wall position
                wall_pos_x = float(row[COL_WALL_POS_X])
                wall_pos_y = float(row[COL_WALL_POS_Y])
                wall_pos_z = float(row[COL_WALL_POS_Z])
                wall_position = Rhino.Geometry.Point3d(wall_pos_x, wall_pos_z, wall_pos_y) # Will always be overwritten
                ## Wall rotation
                wall_rot_x = float(row[COL_WALL_ROT_X])
                wall_rot_y = float(row[COL_WALL_ROT_Y])
                wall_rot_z = float(row[COL_WALL_ROT_Z])
                wall_rotation = Rhino.Geometry.Point3d(wall_rot_x, wall_rot_z, wall_rot_y) # Will always be overwritten
                ## Gaze position
                #gaze_origin_x = float(row[23]) * measure_conv
                #gaze_origin_y = float(row[24]) * measure_conv
                #gaze_origin_z = float(row[25]) * measure_conv
                ## Gaze rotation
                #gaze_rot_x = float(row[26])
                #gaze_rot_y = float(row[27])
                #gaze_rot_z = float(row[28])
                ## Menu position
                menu_pos_x = float(row[COL_MENU_POS_X])
                menu_pos_y = float(row[COL_MENU_POS_Y])
                menu_pos_z = float(row[COL_MENU_POS_Z])
                menu_positions.append(Rhino.Geometry.Point3d(menu_pos_x, menu_pos_z, menu_pos_y))
                ## Menu rotation
                menu_rot_x = float(row[COL_MENU_ROT_X])
                menu_rot_y = float(row[COL_MENU_ROT_Y])
                menu_rot_z = float(row[COL_MENU_ROT_Z])
                menu_rotations.append(Rhino.Geometry.Point3d(menu_rot_x, menu_rot_z, menu_rot_y))
                ## Menu scale
                menu_scale_x = float(row[COL_MENU_SCALE_X])
                menu_scale_y = float(row[COL_MENU_SCALE_Y])
                menu_scale_z = float(row[COL_MENU_SCALE_Z])
                menu_scales.append(Rhino.Geometry.Point3d(menu_scale_x, menu_scale_z, menu_scale_y))
                ## Menu visible
                menu_visibles.append((row[COL_MENU_VISIBLE].upper().strip() == "TRUE"))
                ## Adjust outputs
                # Wall position and rotation (will always be overwritten by last value
                
                
                # Append to mega list
                """
                head_data.append([\
                (pos_x, pos_y, pos_z),
                (rot_x, rot_y, rot_z),
                (gaze_origin_x, gaze_origin_y, gaze_origin_z),
                (gaze_rot_x, gaze_rot_y, gaze_rot_z),
                timestamp,
                experiment_started \
                ])
                # Set Facade info to last row's values
                facade_pos = Rhino.Geometry.Point3d(facade_pos_x, facade_pos_y, facade_pos_z)
                #facade_rot = [facade_rot_x, facade_rot_y, facade_rot_z]
                facade_rot = Rhino.Geometry.Vector3d(facade_rot_x, facade_rot_y, facade_rot_z)
                # Print Debug values
                #print(timestamp.strftime(datetime_format)[:-3])
                print((pos_x, pos_y, pos_z))
                """
    #except Exception as e:
    #    raise e
    
    """
    for i in range(0, len(head_data) - 1):
        #Rhino.Geometry.Point3d(
        points.append(Rhino.Geometry.Point3d(head_data[i][0][0], head_data[i][0][1], head_data[i][0][2]))
        head_rotations.append(Rhino.Geometry.Point3d(head_data[i][1][0], head_data[i][1][1], head_data[i][1][2]))
    """
# ---------- end get_head_data ----------
panel = Panel(get_head_data.out)
panel_2 = Panel("Point frequency")
list = ValueList({"0.25s": 1, "0.5s": 2, "0.75s": 3, "1.0s": 4, "2.0s": 8, "3.0s": 12}, selected="0.5s")
lng = ListLength()
division = Division(A=lng, B=list)
lng_2 = ListLength()
division_2 = Division(A=lng_2, B=list)
round = Round(Number=division)  # -> Nearest, Floor, Ceiling
# Set time sequence
# Head points
series = Series(Start="0", Step=list, Count=round.Floor)
item = ListItem(Index=series, Wrap=Toggle(False))
round_2 = Round(Number=division_2)  # -> Nearest, Floor, Ceiling
# Head rotation vectors
series_2 = Series(Start="0", Step=list, Count=round_2.Floor)
item_2 = ListItem(Index=series_2, Wrap=Toggle(False))
pdecon_2 = Deconstruct(Point=item_2)  # -> XComponent, YComponent, ZComponent
vec = VectorXYZ(XComponent=pdecon_2.XComponent, YComponent=pdecon_2.YComponent, ZComponent=pdecon_2.ZComponent)  # -> Vector, Length
# Turn points to lines
panel_3 = Panel("-1")
cull_i = CullIndex(List=item, Indices=panel_3, Wrap=True)
shift = ShiftList(List=item, Shift="1", Wrap=Toggle(False))
ln = Line(StartPoint=cull_i, EndPoint=shift)
# Wall height
panel_4 = Panel("1.581")
# Wall width
panel_5 = Panel("1.524")
panel_6 = Panel("Wall")
# IMPORTED FROM FACADES PROJECT
panel_7 = Panel("Head")
pdecon_3 = Deconstruct(Point=get_head_data.wall_position)  # -> XComponent, YComponent, ZComponent
subtraction = Subtraction(A=pdecon_3.ZComponent, B=panel_4)
addition = Addition(A=pdecon_3.ZComponent, B=panel_4)
addition_2 = Addition(A=pdecon_3.XComponent, B=panel_5)
# Construct
pt = ConstructPoint(XCoordinate=pdecon_3.XComponent, YCoordinate=pdecon_3.YComponent, ZCoordinate=pdecon_3.ZComponent)
pt_2 = ConstructPoint(XCoordinate=addition_2, YCoordinate=pdecon_3.YComponent, ZCoordinate=pdecon_3.ZComponent)
pt_3 = ConstructPoint(XCoordinate=addition_2, YCoordinate=pdecon_3.YComponent, ZCoordinate=subtraction)
pt_4 = ConstructPoint(XCoordinate=pdecon_3.XComponent, YCoordinate=pdecon_3.YComponent, ZCoordinate=subtraction)
# Create line
panel_8 = Panel("-1")
cull_i_2 = CullIndex(List=get_head_data.head_positions, Indices=panel_8, Wrap=True)
shift_2 = ShiftList(List=get_head_data.head_positions, Shift="1", Wrap=Toggle(False))
# Top-left point
srf4pt = _4PointSurface(CornerA=pt, CornerB=pt_2, CornerC=pt_3, CornerD=pt_4)
ln_2 = Line(StartPoint=cull_i_2, EndPoint=shift_2)
devec = DeconstructVector(Vector=get_head_data.wall_rotation)  # -> XComponent, YComponent, ZComponent
devec_2 = DeconstructVector(Vector=get_head_data.wall_rotation)  # -> XComponent, YComponent, ZComponent
devec_3 = DeconstructVector(Vector=get_head_data.wall_rotation)  # -> XComponent, YComponent, ZComponent
rad = Radians(Degrees=devec.YComponent)
rad_2 = Radians(Degrees=devec_2.ZComponent)
# Rotate to match data
rad_3 = Radians(Degrees=devec_3.XComponent)
# Start point
startpoint = Slider(0, range=0..10000)
vec_2 = VectorXYZ(XComponent="0", YComponent="1", ZComponent="0")  # -> Vector, Length
# End point
lng_3 = ListLength(List=ln_2)
neg = Negative(Value=rad_2)
vec_3 = VectorXYZ(XComponent="0", YComponent="0", ZComponent="1")  # -> Vector, Length
neg_2 = Negative(Value=rad)
vec_4 = VectorXYZ(XComponent="1", YComponent="0", ZComponent="0")  # -> Vector, Length
neg_3 = Negative(Value=rad_3)
rot3d = Rotate3D(Geometry=srf4pt, Angle=neg_3, Center=pt, Axis=vec_4.Vector)  # -> Geometry, Transform
rot3d_2 = Rotate3D(Geometry=rot3d.Geometry, Angle=neg_2, Center=pt, Axis=vec_2.Vector)  # -> Geometry, Transform
rot3d_3 = Rotate3D(Geometry=rot3d_2.Geometry, Angle=neg, Center=pt, Axis=vec_3.Vector)  # -> Geometry, Transform
# Color the line
dom = ConstructDomain(DomainStart=startpoint, DomainEnd=lng_3)
subtraction_2 = Subtraction(A=lng_3, B=startpoint)
range = Range(Domain=dom, Steps=subtraction_2)
# Main facade height
panel_9 = Panel("2.651")
# Main facade width
panel_10 = Panel("3.051")
gradient = Gradient(
    LowerLimit=startpoint,
    UpperLimit=lng_3,
    Parameter=range,
    stops=[0: RGB(255, 0, 0), 0.254: RGB(255, 192, 192), 0.497: RGB(255, 255, 255), 0.751: RGB(192, 192, 255), 1: RGB(0, 0, 255)])
startpoint_2 = Slider(0, range=0..10000)
endpoint = Slider(30, range=0..10000)
panel_13 = Panel("""IDEA #1
BAD""")
panel_14 = Panel("Chosen Start point")
panel_15 = Panel("'Real' Start point")
panel_16 = Panel("'Real' End point")
lng_4 = ListLength(List=ln)
panel_17 = Panel("Chosen End point")
relay = Relay()
pdecon_4 = Deconstruct(Point=relay)  # -> XComponent, YComponent, ZComponent
panel_18 = Panel(lng_4)
relay_2 = Relay()
lng_5 = ListLength()
index = ItemIndex()
subtraction_3 = Subtraction(A=pdecon_4.XComponent, B=panel_10)
addition_3 = Addition(A=pdecon_4.ZComponent, B=panel_9)
addition_4 = Addition(A=pdecon_4.XComponent, B=panel_10)
preview = CustomPreview(Geometry=ln_2, Material=gradient)
# IGNORE
addition_5 = Addition(A=index, B="1")
# Make Facade
# Create facade
pt_5 = ConstructPoint(XCoordinate=pdecon_4.XComponent, YCoordinate=pdecon_4.YComponent, ZCoordinate=pdecon_4.ZComponent)
pt_6 = ConstructPoint(XCoordinate=addition_4, YCoordinate=pdecon_4.YComponent, ZCoordinate=pdecon_4.ZComponent)
pt_7 = ConstructPoint(XCoordinate=addition_4, YCoordinate=pdecon_4.YComponent, ZCoordinate=addition_3)
pt_8 = ConstructPoint(XCoordinate=pdecon_4.XComponent, YCoordinate=pdecon_4.YComponent, ZCoordinate=addition_3)
# Trim points list
gradient_2 = Gradient(
    LowerLimit="0",
    UpperLimit=lng_5,
    Parameter=index,
    stops=[0: RGB(255, 0, 0), 0.254: RGB(255, 192, 192), 0.497: RGB(255, 255, 255), 0.751: RGB(192, 192, 255), 1: RGB(0, 0, 255)])
panel_19 = Panel()
min = Minimum(A=endpoint, B=panel_18)
min_2 = Minimum(A=min, B=startpoint_2)
bool = Boolean(False)
bool_2 = Boolean(False)
srf4pt_2 = _4PointSurface(CornerA=pt_5, CornerB=pt_6, CornerC=pt_7, CornerD=pt_8)
run_2 = BooleanToggle(False)
line = Line(ln)
item_3 = ListItem(Index=index, Wrap=bool)
item_4 = ListItem(Index=addition_5, Wrap=bool_2)
dom_2 = ConstructDomain(DomainStart=min_2, DomainEnd=min)
subtraction_4 = Subtraction(A=min, B=min_2)
graph_head_data = GhPythonScript(
    should_draw=run_2,
    head_point_a=item_3,
    head_point_b=item_4,
    line_color=gradient_2,
    gui_test_complete_timestamp=panel_19,
    path_layer_name="subject_path")  # -> out; disabled
# ---------- graph_head_data: Python ----------
__author__ = "John"
__version__ = "2022.03.16"

import rhinoscriptsyntax as rs
from datetime import datetime

"""
[
((pos_x,pos_y,pos_z), (rot_x,rot_y,rot_z), (gaze_pos_x, gaze_pos_y, gaze_pos_z), (gaze_rot_x, gaze_rot_y, gaze_rot_z), datetime, should_draw),
((pos_x,pos_y,pos_z), (rot_x,rot_y,rot_z), (gaze_pos_x, gaze_pos_y, gaze_pos_z), (gaze_rot_x, gaze_rot_y, gaze_rot_z), datetime, should_draw),
...
]
"""
conversion_rate = 100.0


rs.scriptcontext.doc = rs.Rhino.RhinoDoc.ActiveDoc

if should_draw == True:
    b_is_valid = True if head_point_b != None else False
    is_past_gui_test = head_point_a[4]
    #s_past_gui_test = True if compare_datetimes() else False
    
    if b_is_valid and is_past_gui_test:
        a_x = head_point_a[0][0] / conversion_rate
        a_y = head_point_a[0][1] / conversion_rate
        a_z = head_point_a[0][2] / conversion_rate
        
        b_x = head_point_b[0][0] / conversion_rate
        b_y = head_point_b[0][1] / conversion_rate
        b_z = head_point_b[0][2] / conversion_rate
        
        pos_a = [a_x, a_y, a_z]
        pos_b = [b_x, b_y, b_z]
        
        line = rs.AddLine(pos_a,pos_b)
        rs.ObjectColor(line, line_color)
        rs.ObjectLayer(line, path_layer_name)
# ---------- end graph_head_data ----------
range_2 = Range(Domain=dom_2, Steps=subtraction_4)
# Rotate
devec_4 = DeconstructVector(Vector=relay_2)  # -> XComponent, YComponent, ZComponent
item_5 = ListItem(List=line, Index=range_2, Wrap=Toggle(False))
rad_4 = Radians(Degrees=devec_4.YComponent)
rot3d_4 = Rotate3D(Geometry=srf4pt_2, Angle=rad_4, Center=pt_5, Axis=Vector(0, 0, 1))  # -> Geometry, Transform
panel_20 = Panel(graph_head_data)
panel_22 = Panel("Z Axis (Rhino)")
# Create material
gradient_3 = Gradient(
    LowerLimit="0",
    UpperLimit=panel_18,
    Parameter=range_2,
    stops=[0: RGB(255, 0, 0), 0.254: RGB(255, 192, 192), 0.497: RGB(255, 255, 255), 0.751: RGB(192, 192, 255), 1: RGB(0, 0, 255)])
subtraction_5 = Subtraction(A="180", B=devec_4.YComponent)
rad_5 = Radians(Degrees=subtraction_5)
vec_5 = VectorXYZ(XComponent="0", YComponent="0", ZComponent="1")  # -> Vector, Length
swatch = ColourSwatch(SwatchColor=RGB(230, 234, 255))
rot3d_5 = Rotate3D(Geometry=item_5, Angle=rad_5, Center=Point(0, 0, 0), Axis=vec_5.Vector)  # -> Geometry, Transform
rot3d_6 = Rotate3D(Geometry=rot3d_4.Geometry, Angle=rad_5, Center=Point(0, 0, 0), Axis=vec_5.Vector)  # -> Geometry, Transform
rot3d_7 = Rotate3D(Geometry=vec.Vector, Angle=rad_5, Center=Point(0, 0, 0), Axis=vec_5.Vector)  # -> Geometry, Transform
# Rotate facade and points to correct orientation
panel_23 = Panel("X Axis")
vec_6 = VectorXYZ(XComponent="1", YComponent="0", ZComponent="0")  # -> Vector, Length
rad_6 = Radians(Degrees=devec_4.XComponent)
rot3d_8 = Rotate3D(Geometry=rot3d_5.Geometry, Angle=rad_6, Center=Point(0, 0, 0), Axis=vec_6.Vector)  # -> Geometry, Transform
rot3d_9 = Rotate3D(Geometry=rot3d_6.Geometry, Angle=rad_6, Center=Point(0, 0, 0), Axis=vec_6.Vector)  # -> Geometry, Transform
rot3d_10 = Rotate3D(Geometry=rot3d_7.Geometry, Angle=rad_6, Center=Point(0, 0, 0), Axis=vec_6.Vector)  # -> Geometry, Transform
# Rotate/Re-position All
panel_24 = Panel("Y Axis (Rhino)")
subtraction_6 = Subtraction(A="180", B=devec_4.ZComponent)
vec_7 = VectorXYZ(XComponent="0", YComponent="1", ZComponent="0")  # -> Vector, Length
rad_7 = Radians(Degrees=subtraction_6)
rot3d_11 = Rotate3D(Geometry=rot3d_8.Geometry, Angle=rad_7, Center=Point(0, 0, 0), Axis=vec_7.Vector)  # -> Geometry, Transform
rot3d_12 = Rotate3D(Geometry=rot3d_10.Geometry, Angle=rad_7, Center=Point(0, 0, 0), Axis=vec_7.Vector)  # -> Geometry, Transform
rot3d_13 = Rotate3D(Geometry=rot3d_9.Geometry, Angle=rad_7, Center=Point(0, 0, 0), Axis=vec_7.Vector)  # -> Geometry, Transform
demesh = DeconstructMesh(Mesh=rot3d_13.Geometry)  # -> Vertices, Faces, Colours, Normals
# Get translation vector
item_6 = ListItem(List=demesh.Vertices, Index=Slider(2, range=0..3), Wrap=True)
vec2pt = Vector2Pt(PointA=item_6, PointB=experiment_reference_point, Unitize=False)  # -> Vector, Length
vdis = VectorDisplay(Anchor=item_6, Vector=vec2pt.Vector)  # disabled
# Translate points/facade
move = Move(Geometry=rot3d_11.Geometry, Motion=vec2pt.Vector)  # -> Geometry, Transform
move_2 = Move(Geometry=rot3d_13.Geometry, Motion=vec2pt.Vector)  # -> Geometry, Transform
vec_8 = VectorXYZ(XComponent=panel_10, YComponent="0", ZComponent=panel_9)  # -> Vector, Length
head_lines = Move(Geometry=move.Geometry, Motion=vec_8.Vector)  # -> Geometry, Transform
facade = Move(Geometry=move_2.Geometry, Motion=vec_8.Vector)  # -> Geometry, Transform
# Opposite corner of window
# Head points
# Base point
# Head angles
# Trim list of angles to match points
# Visualize
panel_25 = Panel("")
unit = UnitVector(Vector=rot3d_12.Geometry)
lng_6 = ListLength(List=head_lines.Geometry)
subtraction_7 = Subtraction(A=lng_6, B=startpoint_2)
dom_3 = ConstructDomain(DomainStart=startpoint_2, DomainEnd=lng_6)
range_3 = Range(Domain=dom_3, Steps=subtraction_7)
cull_i_3 = CullIndex(List=range_3, Indices="-1", Wrap=True)
end = EndPoints(Curve=head_lines.Geometry)  # -> Start, End
item_7 = ListItem(List=unit, Index=cull_i_3, Wrap=True)
preview_2 = CustomPreview(Geometry=head_lines.Geometry, Material=gradient_3)
vdis_2 = VectorDisplay(Anchor=end.Start, Vector=item_7)
