# Grasshopper definition PlotSubjectData_ISMAR2023.gh (Grasshopper 1.0.7)

panel = Panel("C:\\Users\\jsermari\\Documents\\AR_RetrofittingTraining\\Data\\Subjects\\PILOTS\\Mihir")
panel_2 = Panel("C:\\Users\\jsermari\\Documents\\AR_RetrofittingTraining\\Data\\Subjects\\16")
panel_3 = Panel("11-16-2022_10-47-04_MANUAL")
concat = Concatenate()
# Set True to run
run = BooleanToggle(True)
not = GateNot(A=run)
# Reference Line (Facade bottom left)
experiment_reference_line = Line(Line((1.473446168, 4.75615, 1.5811), (1.473446168, 3.75615, 1.5811)))
t = Slider(0.826, range=0..1)
# Display Colors
head_pos_color = ColourSwatch(SwatchColor=RGB(245, 241, 5))
# View Type
list = ValueList({"None": 1, "Eye": 2, "Head": 3, "Line": 4, "Eye/Head": 5, "Eye/Line": 6, "Head/Line": 7, "All": 8}, selected="Line")
head_color_2 = ColourSwatch(SwatchColor=RGB(132, 28, 173))
# Highlights
show_highlight = BooleanToggle(False)
head_color = ColourSwatch(SwatchColor=RGBA(205, 79, 255, 85))
eye_color_2 = ColourSwatch(SwatchColor=RGB(0, 148, 153))
floor_color = ColourSwatch(SwatchColor=RGB(255, 214, 48))
eye_color = ColourSwatch(SwatchColor=RGBA(79, 249, 255, 85))
get_head_data = GhPythonScript(run=run, data_dir=panel_2, subject="01-17-2023_13-24-27_AUTO")  # -> out, gui_test_complete_timestamp, head_positions, head_rotations, gaze_rotations, wall_visibles, wall_position, wall_rotation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
# ---------- get_head_data: Python ----------
__author__ = "John"
__version__ = "2022.03.15"

import rhinoscriptsyntax as rs
import Rhino
import csv
import os
from datetime import datetime
import math

datetime_format = '%H:%M:%S.%f'
"""
[
((pos_x,pos_y,pos_z), (rot_x,rot_y,rot_z), (gaze_pos_x, gaze_pos_y, gaze_pos_z), (gaze_rot_x, gaze_rot_y, gaze_rot_z), datetime, should_draw),
((pos_x,pos_y,pos_z), (rot_x,rot_y,rot_z), (gaze_pos_x, gaze_pos_y, gaze_pos_z), (gaze_rot_x, gaze_rot_y, gaze_rot_z), datetime, should_draw),
...
]
"""
# Input values
#head_data = []
#points = []
#head_rotations = []
# Output values
head_positions = []
head_rotations = []
gaze_rotations = []
wall_visibles = []
wall_position = None
wall_rotation = None
menu_visibles = []
menu_positions = []
menu_rotations = []
menu_scales = []
timestamps = []
# Script values
rs.scriptcontext.doc = rs.Rhino.RhinoDoc.ActiveDoc
experiment_start_timestamp = None
# Column numbers for data files
COL_DATA_TYPE = 0
COL_TASK_NUMBER = 4
COL_TIMESTAMP = 2
COL_HEAD_POS_X = 5
COL_HEAD_POS_Y = 6
COL_HEAD_POS_Z = 7
COL_HEAD_ROT_X = 8
COL_HEAD_ROT_Y = 9
COL_HEAD_ROT_Z = 10
COL_WALL_VISIBLE = 11
COL_WALL_POS_X = 12
COL_WALL_POS_Y = 13
COL_WALL_POS_Z = 14
COL_WALL_ROT_X = 15
COL_WALL_ROT_Y = 16
COL_WALL_ROT_Z = 17
COL_GAZE_ROT_X = 23
COL_GAZE_ROT_Y = 24
COL_GAZE_ROT_Z = 25
COL_MENU_POS_X = 26
COL_MENU_POS_Y = 27
COL_MENU_POS_Z = 28
COL_MENU_ROT_X = 29
COL_MENU_ROT_Y = 30
COL_MENU_ROT_Z = 31
COL_MENU_SCALE_X = 32
COL_MENU_SCALE_Y = 33
COL_MENU_SCALE_Z = 34
COL_MENU_VISIBLE = 35
# Conversion ratio
conversion_factor = 1.0

def read_timestamp(cell_value):
    data = cell_value.strip()
    # Data
    date = data.split("_")[0]
    month = int(date.split("-")[0])
    day = int(date.split("-")[1])
    year = int(date.split("-")[2])
    # Time
    time = data.split("_")[1]
    hour = int(time.split("-")[0])
    minute = int(time.split("-")[1])
    second = int(time.split("-")[2])
    millisecond = int(time.split("-")[3])
    microsecond = millisecond * 1000
    
    return datetime(year, month, day, hour, minute, second, microsecond)

"""
def tranform_according_to_ref(x, y, z, ref_point, facade_pos):
    x_ref = ref_point[0]
    y_ref = ref_point[1]
    z_ref = ref_point[2]
    facade_x = facade_pos[0]
    facade_y = facade_pos[1]
    facade_z = facade_pos[2]
    # TODO
    return x, y, z
"""

##### MAIN #####
# Get subject data file
if run == True:
    subject_data_file = data_dir + "\\" + subject + ".csv"
    assert os.path.isfile(subject_data_file), "ERROR: File " + subject_data_file + " not found."
    print("Opening " + subject_data_file)
    """
    # Get facade position by reading last row in csv
    with open(subject_data_file) as csvfile:
        reader = csv.reader(csvfile, delimiter=",")
        i = 0
        for row in reader:
            if i == 0:
                i = i + 1
                continue
            if row[WALL_POS_X] != "":
                # Clear old values if necessary to reduce memory usage
                if wall_position != None:
                    wall_position.clear()
                if wall_rotation != None:
                    wall_rotation.clear()
                # Assign new values
                wall_position = [ \
                float(row[COL_WALL_POS_X]),
                float(row[COL_WALL_POS_Y]),
                float(row[COL_WALL_POS_Z])]
                wall_rotation = [ \
                float(row[COL_WALL_ROT_X],
                float(row[COL_WALL_ROT_X],
                float(row[COL_WALL_ROT_X])]
            i = i + 1
    """
    # Read subject data
    with open(subject_data_file) as csvfile:
        reader = csv.reader(csvfile, delimiter=",")
        for row in reader:
            type = row[COL_DATA_TYPE]
            if type=="Task_Started" and (row[COL_TASK_NUMBER].strip() == "1a"):
                experiment_start_timestamp = read_timestamp(row[COL_TIMESTAMP])
            if type == "Head":
                ## Timestamp
                timestamp = read_timestamp(row[COL_TIMESTAMP])
                timestamps.append(timestamp)
                ## Determine if experiment had started
                experiment_started = True
                if experiment_start_timestamp == None or timestamp <= experiment_start_timestamp:
                    experiment_started = False
                    continue
                ## Head position
                head_pos_x = float(row[COL_HEAD_POS_X]) * conversion_factor
                head_pos_y = float(row[COL_HEAD_POS_Y]) * conversion_factor
                head_pos_z = float(row[COL_HEAD_POS_Z]) * conversion_factor
                # Swap y and z to convert from left handed (unreal) to right handed (rhino) coordinate system
                head_positions.append(Rhino.Geometry.Point3d(head_pos_x, head_pos_z, head_pos_y))
                ## Head rotation
                head_rot_x = float(row[COL_HEAD_ROT_X])
                head_rot_y = float(row[COL_HEAD_ROT_Y])
                head_rot_z = float(row[COL_HEAD_ROT_Z])
                # Swap y and z to convert from left handed (unreal) to right handed (rhino) coordinate system
                head_rotations.append(Rhino.Geometry.Point3d(head_rot_x, head_rot_z, head_rot_y))
                ## Wall visible
                wall_visibles.append((row[COL_WALL_VISIBLE].upper().strip() == "TRUE"))
                ## Wall position
                wall_pos_x = float(row[COL_WALL_POS_X]) * conversion_factor
                wall_pos_y = float(row[COL_WALL_POS_Y]) * conversion_factor
                wall_pos_z = float(row[COL_WALL_POS_Z]) * conversion_factor
                # Swap y and z to convert from left handed (unreal) to right handed (rhino) coordinate system
                wall_position = Rhino.Geometry.Point3d(wall_pos_x, wall_pos_z, wall_pos_y) # Will always be overwritten
                ## Wall rotation
                wall_rot_x = float(row[COL_WALL_ROT_X])
                wall_rot_y = float(row[COL_WALL_ROT_Y])
                wall_rot_z = float(row[COL_WALL_ROT_Z])
                # Swap y and z to convert from left handed (unreal) to right handed (rhino) coordinate system
                wall_rotation = Rhino.Geometry.Point3d(wall_rot_x, wall_rot_z, wall_rot_y) # Will always be overwritten
                ## Gaze rotation
                gaze_rot_x = float(row[COL_GAZE_ROT_X])
                gaze_rot_y = float(row[COL_GAZE_ROT_Y])
                gaze_rot_z = float(row[COL_GAZE_ROT_Z])
                # Swap y and z to convert from left handed (unreal) to right handed (rhino) coordinate system
                gaze_rotations.append(Rhino.Geometry.Point3d(gaze_rot_x, gaze_rot_z, gaze_rot_y))
                ## Menu position
                menu_pos_x = float(row[COL_MENU_POS_X]) * conversion_factor
                menu_pos_y = float(row[COL_MENU_POS_Y]) * conversion_factor
                menu_pos_z = float(row[COL_MENU_POS_Z]) * conversion_factor
                # Swap y and z to convert from left handed (unreal) to right handed (rhino) coordinate system
                menu_positions.append(Rhino.Geometry.Point3d(menu_pos_x, menu_pos_z, menu_pos_y))
                ## Menu rotation
                menu_rot_x = float(row[COL_MENU_ROT_X])
                menu_rot_y = float(row[COL_MENU_ROT_Y])
                menu_rot_z = float(row[COL_MENU_ROT_Z])
                # Swap y and z to convert from left handed (unreal) to right handed (rhino) coordinate system
                menu_rotations.append(Rhino.Geometry.Point3d(menu_rot_x, menu_rot_z, menu_rot_y))
                ## Menu scale
                menu_scale_x = float(row[COL_MENU_SCALE_X])
                menu_scale_y = float(row[COL_MENU_SCALE_Y])
                menu_scale_z = float(row[COL_MENU_SCALE_Z])
                # Swap y and z to convert from left handed (unreal) to right handed (rhino) coordinate system
                menu_scales.append(Rhino.Geometry.Point3d(menu_scale_x, menu_scale_z, menu_scale_y))
                ## Menu visible
                menu_visibles.append((row[COL_MENU_VISIBLE].upper().strip() == "TRUE"))
            elif "Menu_Pin":
                pass
            # TODO REST
# ---------- end get_head_data ----------
get_head_data_2 = GhPythonScript(run=run, data_dir=panel_2, progress_tracker_file="ProgressTracker_MANUAL_01_17_2023-13_25_05_172665")  # -> out, task_names, task_numbers, timestamps
# ---------- get_head_data_2: Python ----------
__author__ = "John"
__version__ = "2022.03.15"

import rhinoscriptsyntax as rs
import Rhino
import csv
import os
from datetime import datetime
import math

datetime_format = '%H:%M:%S.%f'

# Output values
task_names = []
task_numbers = []
timestamps = []
# Script values
rs.scriptcontext.doc = rs.Rhino.RhinoDoc.ActiveDoc
experiment_start_timestamp = None
# Column numbers for data files
COL_TASK_ID = 0
COL_TASK_NAME = 1
COL_HOUR = 2
COL_MINUTE = 3
COL_SECOND = 4 
COL_MICROSECOND = 5

def pull_metadata(timestamp_cell):
    data = timestamp_cell.strip()
    # Data
    date = data.split("-")[0]
    month = int(date.split("_")[0])
    day = int(date.split("_")[1])
    year = int(date.split("_")[2])
    
    return month, day, year

"""
def tranform_according_to_ref(x, y, z, ref_point, facade_pos):
    x_ref = ref_point[0]
    y_ref = ref_point[1]
    z_ref = ref_point[2]
    facade_x = facade_pos[0]
    facade_y = facade_pos[1]
    facade_z = facade_pos[2]
    # TODO
    return x, y, z
"""

##### MAIN #####
# Get subject data file
if run == True:
    subject_data_file = data_dir + "\\" + progress_tracker_file + ".csv"
    assert os.path.isfile(subject_data_file), "ERROR: File " + subject_data_file + " not found."
    print("Opening " + subject_data_file)

    # Read subject data
    with open(subject_data_file) as csvfile:
        reader = csv.reader(csvfile, delimiter=",")
        i = 0
        for row in reader:
            # Metadata
            if i == 0:
                month, day, year = pull_metadata(row[5])
                i = i + 1
                continue
            # Column names
            if i == 1:
                i = i + 1
                continue
            # Read input
            task_id = row[COL_TASK_ID]
            task_name = row[COL_TASK_NAME]
            hour = row[COL_HOUR]
            minute = row[COL_MINUTE]
            second = row[COL_SECOND]
            microsecond = row[COL_MICROSECOND]
            # Create timestamp (if possible)
            timestamp = None
            if hour != "":
                timestamp = datetime(year, month, day, int(hour), int(minute), int(second), int(microsecond))
            # Output values
            task_names.append(task_name)
            task_numbers.append(task_id)
            timestamps.append(timestamp)
            i = i + 1
# ---------- end get_head_data_2 ----------
end = EndPoints(Curve=experiment_reference_line)  # -> Start, End
panel_4 = Panel(get_head_data.out)
vec2pt = Vector2Pt(PointA=end.Start, PointB=end.End, Unitize=Toggle(True))  # -> Vector, Length
vdis = VectorDisplay(Anchor=end.Start, Vector=vec2pt.Vector)
panel_5 = Panel("Point frequency")
list_2 = ValueList({"0.25s": 1, "0.5s": 2, "0.75s": 3, "1.0s": 4, "2.0s": 8, "3.0s": 12}, selected="0.5s")
lng = ListLength()
division = Division(A=lng, B=list_2)
# IMPORTED FROM FACADES PROJECT
# Head points
read_timestamp = Read_timestamp()  # -> out, year, month, day, hour, minute, second, microsecond
# ---------- read_timestamp: Python ----------
__author__ = "jsermari"
__version__ = "2023.02.06"

import rhinoscriptsyntax as rs
from datetime import datetime

timestamp = None

has_microsecond = "." in timestamp_str
if has_microsecond:
    timestamp = datetime.strptime(timestamp_str, '%Y-%m-%d %H:%M:%S.%f')
else:
    timestamp = datetime.strptime(timestamp_str, '%Y-%m-%d %H:%M:%S')
print(timestamp)

year = timestamp.year
month = timestamp.month
day = timestamp.day
hour = timestamp.hour
minute = timestamp.minute
second = timestamp.second
if has_microsecond:
    microsecond = timestamp.microsecond
else:
    microsecond = 0
# ---------- end read_timestamp ----------
lng_2 = ListLength()
division_2 = Division(A=lng_2, B=list_2)
round = Round(Number=division)  # -> Nearest, Floor, Ceiling
# Set time sequence
series = Series(Start="0", Step=list_2, Count=round.Floor)
# Head rotation vectors
item = ListItem(Index=series, Wrap=Toggle(False))
round_2 = Round(Number=division_2)  # -> Nearest, Floor, Ceiling
series_2 = Series(Start="0", Step=list_2, Count=round_2.Floor)
item_2 = ListItem(Index=series_2, Wrap=Toggle(False))
pdecon = Deconstruct(Point=item_2)  # -> XComponent, YComponent, ZComponent
vec = VectorXYZ(XComponent=pdecon.XComponent, YComponent=pdecon.YComponent, ZComponent=pdecon.ZComponent)  # -> Vector, Length
# Turn points to lines
panel_6 = Panel("-1")
panel_7 = Panel("Create Head Rotations")
panel_8 = Panel("Create Menu Positions")
panel_9 = Panel("Create Menu Rotations")
panel_10 = Panel("Create Head path")
panel_11 = Panel("Create Gaze Rotations")
panel_12 = Panel("Highlight (Single moment)")
cull_i = CullIndex(List=item, Indices=panel_6, Wrap=True)
shift = ShiftList(List=item, Shift="1", Wrap=Toggle(False))
lng_3 = ListLength(List=get_head_data.head_positions)
pdecon_2 = Deconstruct(Point=get_head_data.head_rotations)  # -> XComponent, YComponent, ZComponent
pdecon_3 = Deconstruct(Point=get_head_data.menu_rotations)  # -> XComponent, YComponent, ZComponent
subtraction = Subtraction(A=lng_3, B="1")
cull_i_2 = CullIndex(List=get_head_data.head_positions, Indices="-1", Wrap=True)
shift_2 = ShiftList(List=get_head_data.head_positions, Shift="1", Wrap=Toggle(False))
ln = Line(StartPoint=cull_i, EndPoint=shift)
# HEAD ROTATIONS
# GAZE ROTATIONS
eulertovec_unity = EulerToVec(x=pdecon_2.XComponent, y=pdecon_2.YComponent, z=pdecon_2.ZComponent)  # -> out, vector
# ---------- eulertovec_unity: Python ----------
__author__ = "John"
__version__ = "2023.01.23"

import rhinoscriptsyntax as rs
import Rhino
import math

# Output values
vector = None

## Convert degrees to radians
"""
pitch = math.radians(pitch)
yaw = math.radians(yaw)
roll = math.radians(roll)
"""
pitch = math.radians(z)
yaw = math.radians(y)
roll = math.radians(x)
## Convert from pitch/yaw/roll to vector
# https://stackoverflow.com/questions/1568568/how-to-convert-euler-angles-to-directional-vector

x_vec = math.cos(yaw) * math.cos(pitch)
y_vec = math.sin(yaw) * math.cos(pitch)
z_vec = math.sin(pitch)
"""
x = -math.cos(yaw) * math.sin(pitch) * math.sin(roll) - math.sin(yaw) * math.cos(roll)
y = -math.sin(yaw) * math.sin(pitch) * math.sin(roll) + math.cos(yaw) * math.cos(roll)
z =  math.cos(pitch) * math.sin(roll)
"""
vector = Rhino.Geometry.Point3d(x_vec, y_vec, z_vec)
# ---------- end eulertovec_unity ----------
# MENU POSITIONS
# MENU ROTATIONS
eulertovec_unity_2 = EulerToVec(x=pdecon_3.XComponent, y=pdecon_3.YComponent, z=pdecon_3.ZComponent)  # -> out, vector; same code as eulertovec_unity
multiplication = Multiplication(A=t, B=subtraction)
# PATH
ln_2 = Line(StartPoint=cull_i_2, EndPoint=shift_2)
# Wall height
panel_13 = Panel("1.581")
# Wall width
panel_14 = Panel("1.524")
panel_15 = Panel("Wall")
# Highlight list index
round_3 = Round(Number=multiplication)  # -> Nearest, Floor, Ceiling
pdecon_4 = Deconstruct(Point=get_head_data.wall_position)  # -> XComponent, YComponent, ZComponent; disabled
relay = Relay()
subtraction_2 = Subtraction(A=pdecon_4.ZComponent, B=panel_13)
pl = PlaneNormal(Origin=end.Start, ZAxis=vec2pt.Vector)
addition = Addition(A=pdecon_4.ZComponent, B=panel_13)
addition_2 = Addition(A=pdecon_4.XComponent, B=panel_14)
# Reference Vectors
deplane = DeconstructPlane(Plane=pl)  # -> Origin, XAxis, YAxis, ZAxis
# Construct
pt = ConstructPoint(XCoordinate=pdecon_4.XComponent, YCoordinate=pdecon_4.YComponent, ZCoordinate=pdecon_4.ZComponent)
pt_2 = ConstructPoint(XCoordinate=addition_2, YCoordinate=pdecon_4.YComponent, ZCoordinate=pdecon_4.ZComponent)
pt_3 = ConstructPoint(XCoordinate=addition_2, YCoordinate=pdecon_4.YComponent, ZCoordinate=subtraction_2)
pt_4 = ConstructPoint(XCoordinate=pdecon_4.XComponent, YCoordinate=pdecon_4.YComponent, ZCoordinate=subtraction_2)
neg = Negative(Value=deplane.YAxis)
neg_2 = Negative(Value=deplane.XAxis)
swatch = ColourSwatch(SwatchColor=RGB(255, 36, 36))
number_slider = Slider(1, range=1..5)
number_slider_2 = Slider(1, range=1..5)
# Unity Data
swatch_2 = ColourSwatch(SwatchColor=RGB(36, 167, 255))
vdisex = VectorDisplayEx(Point=deplane.Origin, Vector=deplane.ZAxis, Colour=swatch, Width=number_slider)
vdisex_2 = VectorDisplayEx(Point=deplane.Origin, Vector=deplane.XAxis, Colour=swatch, Width=number_slider)
vdisex_3 = VectorDisplayEx(Point=deplane.Origin, Vector=neg, Colour=swatch, Width=number_slider)
# Top-left point
srf4pt = _4PointSurface(CornerA=pt, CornerB=pt_2, CornerC=pt_3, CornerD=pt_4)
# Convert from Unity to Rhino Coordinates (Position)
# Convert from Euler to Vector
pdecon_5 = Deconstruct(Point=get_head_data.wall_rotation)  # -> XComponent, YComponent, ZComponent
_0 = Number(0)
_1 = Number(1)
devec = DeconstructVector(Vector=get_head_data.wall_rotation)  # -> XComponent, YComponent, ZComponent
devec_2 = DeconstructVector(Vector=get_head_data.wall_rotation)  # -> XComponent, YComponent, ZComponent
devec_3 = DeconstructVector(Vector=get_head_data.wall_rotation)  # -> XComponent, YComponent, ZComponent
eulertovec = EulerToVec(x=pdecon_5.XComponent, y=pdecon_5.YComponent, z=pdecon_5.ZComponent)  # -> out, vector; same code as eulertovec_unity
# Convert from Unreal to Rhino Coordinates (Rotation)
pl_2 = PlaneNormal(Origin=end.Start, ZAxis=eulertovec.vector)
deplane_2 = DeconstructPlane(Plane=pl_2)  # -> Origin, XAxis, YAxis, ZAxis
line = LineSDL(Start=deplane_2.Origin, Direction=deplane_2.XAxis, Length=1)
line_2 = LineSDL(Start=deplane_2.Origin, Direction=deplane_2.YAxis, Length=1)
line_3 = LineSDL(Start=deplane_2.Origin, Direction=deplane_2.ZAxis, Length=1)
vdisex_4 = VectorDisplayEx(Point=deplane_2.Origin, Vector=deplane_2.XAxis, Colour=swatch_2, Width=number_slider_2)
vdisex_5 = VectorDisplayEx(Point=deplane_2.Origin, Vector=deplane_2.YAxis, Colour=swatch_2, Width=number_slider_2)
vdisex_6 = VectorDisplayEx(Point=deplane_2.Origin, Vector=deplane_2.ZAxis, Colour=swatch_2, Width=number_slider_2)
rad = Radians(Degrees=devec.YComponent)
rad_2 = Radians(Degrees=devec_2.ZComponent)
# Rotate to match data
rad_3 = Radians(Degrees=devec_3.XComponent)
vec_2 = VectorXYZ(XComponent=_1, YComponent=_0, ZComponent=_0)  # -> Vector, Length
vec_3 = VectorXYZ(XComponent=_0, YComponent=_1, ZComponent=_0)  # -> Vector, Length
vec_4 = VectorXYZ(XComponent=_1, YComponent=_0, ZComponent=_0)  # -> Vector, Length
vec_5 = VectorXYZ(XComponent=_0, YComponent=_0, ZComponent=_1)  # -> Vector, Length
vec_6 = VectorXYZ(XComponent=_0, YComponent=_1, ZComponent=_0)  # -> Vector, Length
vec_7 = VectorXYZ(XComponent=_0, YComponent=_0, ZComponent=_1)  # -> Vector, Length
vdis_2 = VectorDisplay(Anchor=get_head_data.wall_position, Vector=eulertovec.vector)
vec_8 = VectorXYZ(XComponent="0", YComponent="1", ZComponent="0")  # -> Vector, Length
neg_3 = Negative(Value=rad_2)
vec_9 = VectorXYZ(XComponent="0", YComponent="0", ZComponent="1")  # -> Vector, Length
neg_4 = Negative(Value=rad)
vec_10 = VectorXYZ(XComponent="1", YComponent="0", ZComponent="0")  # -> Vector, Length
neg_5 = Negative(Value=rad_3)
# XY
pl_3 = ConstructPlane(Origin=deplane.Origin, XAxis=vec_2.Vector, YAxis=vec_3.Vector)
# XZ
pl_4 = ConstructPlane(Origin=deplane.Origin, XAxis=vec_4.Vector, YAxis=vec_5.Vector)
# YZ
pl_5 = ConstructPlane(Origin=deplane.Origin, XAxis=vec_6.Vector, YAxis=vec_7.Vector)
panel_16 = Panel("Task Info")
rot3d = Rotate3D(Geometry=srf4pt, Angle=neg_5, Center=pt, Axis=vec_10.Vector)  # -> Geometry, Transform
rot3d_2 = Rotate3D(Geometry=rot3d.Geometry, Angle=neg_4, Center=pt, Axis=vec_8.Vector)  # -> Geometry, Transform
rot3d_3 = Rotate3D(Geometry=rot3d_2.Geometry, Angle=neg_3, Center=pt, Axis=vec_9.Vector)  # -> Geometry, Transform
item_3 = ListItem(List=get_head_data.timestamps, Index=round_3.Nearest, Wrap=True)
angle = Angle(VectorA=deplane_2.XAxis, VectorB=deplane.XAxis, Plane=pl_5)  # -> Angle, Reflex
panel_17 = Panel("Translate")
vec2pt_2 = Vector2Pt(PointA=get_head_data.wall_position, PointB=end.Start, Unitize=False)  # -> Vector, Length
min = Minimum(A=angle.Angle, B=angle.Reflex)
panel_18 = Panel("Test manual translations")
get_current_task = GhPythonScript(
    task_timestamps=flatten(get_head_data_2.timestamps),
    task_names=flatten(get_head_data_2.task_names),
    task_ids=flatten(get_head_data_2.task_numbers),
    timestamp_current=item_3)  # -> out, task_id, task_name, task_start_timestamp; inputs task_timestamps: list, task_names: list, task_ids: list, timestamp_current: list
# ---------- get_current_task: Python ----------
__author__ = "jsermari"
__version__ = "2023.02.07"

import rhinoscriptsyntax as rs
from datetime import datetime

rs.scriptcontext.doc = rs.Rhino.RhinoDoc.ActiveDoc

"""
def get_surfaces(facade_name):
    #print(rs.LayerChildren("facades::Pos1"))
    #rs.LayerId()
    
    facade_pos1 = None
    layer_name = "facades::Pos1" + "::" + facade_name
    facade_pos1 = rs.ObjectsByLayer(layer_name)
    #print(rs.ObjectsByLayer(layer_name))
    
    facade_pos2 = None
    if(rs.IsLayer("facades::Pos2")):
        layer_name = "facades::Pos2" + "::" + facade_name
        facade_pos2 = rs.ObjectsByLayer(layer_name)
    return facade_pos1, facade_pos2

has_microsecond = "." in timestamp_current
if has_microsecond:
    timestamp = datetime.strptime(timestamp_current, '%Y-%m-%d %H:%M:%S.%f')
else:
    timestamp = datetime.strptime(timestamp_current, '%Y-%m-%d %H:%M:%S')

facade_surface = None
facade_name = None
switched_time = None

# Find most recent active facade
for i in range(0, len(facade_list)):
    facade = facade_list[i]
    f_timestamp_str = facade_timestamps[i]
    
    has_microsecond = "." in f_timestamp_str
    if has_microsecond:
        f_timestamp = datetime.strptime(f_timestamp_str, '%Y-%m-%d %H:%M:%S.%f')
    else:
        f_timestamp = datetime.strptime(f_timestamp_str, '%Y-%m-%d %H:%M:%S')
    # Exit if needed
    if f_timestamp > timestamp:
        break
    # Update values
    facade_surfaces = get_surfaces(facade)
    facade_surface1 = facade_surfaces[0]
    facade_surface2 = facade_surfaces[1]
    facade_name = facade
    switched_time = f_timestamp
"""
# ---------- end get_current_task ----------
read_timestamp_2 = Read_timestamp()  # -> out, year, month, day, hour, minute, second, microsecond; same code as read_timestamp
move = Move(Geometry=ln_2, Motion=vec2pt_2.Vector)  # -> Geometry, Transform
move_2 = Move(Geometry=get_head_data.menu_positions, Motion=vec2pt_2.Vector)  # -> Geometry, Transform
startpoint = Slider(0, range=0..10000)
endpoint = Slider(30, range=0..10000)
# Main facade width
# Main facade height
panel_21 = Panel("""IDEA #1
BAD""")
panel_22 = Panel("Chosen Start point")
panel_23 = Panel("'Real' Start point")
panel_24 = Panel("'Real' End point")
lng_4 = ListLength(List=ln)
panel_25 = Panel("Chosen End point")
relay_2 = Relay()
pdecon_6 = Deconstruct(Point=relay_2)  # -> XComponent, YComponent, ZComponent
panel_26 = Panel(lng_4)
relay_3 = Relay()
lng_5 = ListLength()
number_slider_3 = Slider(0, range=0..360)
number_slider_4 = Slider(91.534, range=0..360)
number_slider_5 = Slider(167.222, range=0..360)
index = ItemIndex()
subtraction_3 = Subtraction(A=pdecon_6.XComponent, B="3.051")
addition_3 = Addition(A=pdecon_6.ZComponent, B="2.651")
addition_4 = Addition(A=pdecon_6.XComponent, B="3.051")
# IGNORE
addition_5 = Addition(A=index, B="1")
# Make Facade
# Create facade
pt_5 = ConstructPoint(XCoordinate=pdecon_6.XComponent, YCoordinate=pdecon_6.YComponent, ZCoordinate=pdecon_6.ZComponent)
pt_6 = ConstructPoint(XCoordinate=addition_4, YCoordinate=pdecon_6.YComponent, ZCoordinate=pdecon_6.ZComponent)
pt_7 = ConstructPoint(XCoordinate=addition_4, YCoordinate=pdecon_6.YComponent, ZCoordinate=addition_3)
pt_8 = ConstructPoint(XCoordinate=pdecon_6.XComponent, YCoordinate=pdecon_6.YComponent, ZCoordinate=addition_3)
# Trim points list
gradient = Gradient(
    LowerLimit="0",
    UpperLimit=lng_5,
    Parameter=index,
    stops=[0: RGB(255, 0, 0), 0.254: RGB(255, 192, 192), 0.497: RGB(255, 255, 255), 0.751: RGB(192, 192, 255), 1: RGB(0, 0, 255)])
tag = TextTag3D(Location=PlaneXZ(1.473446168, 4.76885, 2.090597324), Text="Task Number", Size=Slider(0.1, range=0..2), Justification=7)
rad_4 = Radians(Degrees=Slider(91.481, range=0..360))
rad_5 = Radians(Degrees=Slider(95.586, range=0..360))
rad_6 = Radians(Degrees=Slider(0, range=0..360))
rad_7 = Radians(Degrees=Slider(0, range=0..359))
rad_8 = Radians(Degrees=Slider(2, range=0..359))
rad_9 = Radians(Degrees=Slider(264, range=0..359))
panel_27 = Panel()
min_2 = Minimum(A=endpoint, B=panel_26)
min_3 = Minimum(A=min_2, B=startpoint)
bool = Boolean(False)
bool_2 = Boolean(False)
srf4pt_2 = _4PointSurface(CornerA=pt_5, CornerB=pt_6, CornerC=pt_7, CornerD=pt_8)
run_2 = BooleanToggle(False)
# Alignment Vectors
vrot = Rotate(Vector=deplane_2.XAxis, Axis=deplane.ZAxis, Angle=min)
head_rot = Rotate(Vector=eulertovec_unity.vector, Axis=deplane.ZAxis, Angle=min)
gaze_rot = Rotate(Vector=get_head_data.gaze_rotations, Axis=deplane.ZAxis, Angle=min)
head_pos = Rotate3D(Angle=min, Center=Point(0, 0, 0), Axis=deplane.ZAxis)  # -> Geometry, Transform
vrot_2 = Rotate(Vector=deplane_2.YAxis, Axis=deplane.ZAxis, Angle=min)
vrot_3 = Rotate(Vector=deplane_2.ZAxis, Axis=deplane.ZAxis, Angle=min)
angle_2 = Angle(VectorA=vrot_3, VectorB=deplane.ZAxis, Plane=pl_3)  # -> Angle, Reflex
min_4 = Minimum(A=angle_2.Angle, B=angle_2.Reflex)
# Alignment Vectors
vrot_4 = Rotate(Vector=vrot, Axis=deplane.YAxis, Angle=angle_2.Angle)
head_pos_2 = Rotate3D(Geometry=head_pos.Geometry, Angle=angle_2.Angle, Center=Point(0, 0, 0), Axis=deplane.YAxis)  # -> Geometry, Transform
head_rot_2 = Rotate(Vector=head_rot, Axis=deplane.YAxis, Angle=angle_2.Angle)
gaze_rot_2 = Rotate(Vector=gaze_rot, Axis=deplane.YAxis, Angle=angle_2.Angle)
vrot_5 = Rotate(Vector=vrot_2, Axis=deplane.YAxis, Angle=angle_2.Angle)
vrot_6 = Rotate(Vector=vrot_3, Axis=deplane.YAxis, Angle=angle_2.Angle)
angle_3 = Angle(VectorA=vrot_6, VectorB=deplane.ZAxis, Plane=pl_4)  # -> Angle, Reflex
deg = Degrees(Radians=angle_3.Angle)
deg_2 = Degrees(Radians=angle_3.Reflex)
max = Maximum(A=angle_3.Angle, B=angle_3.Reflex)
# Alignment Vectors
vrot_7 = Rotate(Vector=vrot_4, Axis=deplane.XAxis, Angle=angle_3.Reflex)
head_rot_3 = Rotate(Vector=head_rot_2, Axis=deplane.XAxis, Angle=angle_3.Reflex)
gaze_rot_3 = Rotate(Vector=gaze_rot_2, Axis=deplane.XAxis, Angle=angle_3.Reflex)
head_pos_3 = Rotate3D(Geometry=head_pos_2.Geometry, Angle=angle_3.Reflex, Center=Point(0, 0, 0), Axis=deplane.XAxis)  # -> Geometry, Transform
vrot_8 = Rotate(Vector=vrot_5, Axis=deplane.XAxis, Angle=angle_3.Reflex)
vrot_9 = Rotate(Vector=vrot_6, Axis=deplane.XAxis, Angle=angle_3.Reflex)
line_4 = Line(ln)
item_4 = ListItem(Index=index, Wrap=bool)
item_5 = ListItem(Index=addition_5, Wrap=bool_2)
vdis_3 = VectorDisplay(Vector=vrot)
vdis_4 = VectorDisplay(Vector=vrot_2)
vdis_5 = VectorDisplay(Vector=vrot_3)
vdis_6 = VectorDisplay(Vector=vrot_4)
vdis_7 = VectorDisplay(Vector=vrot_7)
vdis_8 = VectorDisplay(Vector=vrot_5)
vdis_9 = VectorDisplay(Vector=vrot_8)
vdis_10 = VectorDisplay(Vector=vrot_6)
vdis_11 = VectorDisplay(Vector=vrot_9)
vec_11 = VectorXYZ(XComponent="1", YComponent="0", ZComponent="0")  # -> Vector, Length
vec_12 = VectorXYZ(XComponent="0", YComponent="1", ZComponent="0")  # -> Vector, Length
# Convert from Unity to Rhino Coordinates (Rotation)
vec_13 = VectorXYZ(XComponent="0", YComponent="0", ZComponent="1")  # -> Vector, Length
dom = ConstructDomain(DomainStart=min_3, DomainEnd=min_2)
subtraction_4 = Subtraction(A=min_2, B=min_3)
# X
rot3d_4 = Rotate3D(Geometry=move.Geometry, Angle=rad_7, Center=end.Start, Axis=vec_11.Vector)  # -> Geometry, Transform
graph_head_data = GhPythonScript(
    should_draw=run_2,
    head_point_a=item_4,
    head_point_b=item_5,
    line_color=gradient,
    gui_test_complete_timestamp=panel_27,
    path_layer_name="subject_path")  # -> out; disabled
# ---------- graph_head_data: Python ----------
__author__ = "John"
__version__ = "2022.03.16"

import rhinoscriptsyntax as rs
from datetime import datetime

"""
[
((pos_x,pos_y,pos_z), (rot_x,rot_y,rot_z), (gaze_pos_x, gaze_pos_y, gaze_pos_z), (gaze_rot_x, gaze_rot_y, gaze_rot_z), datetime, should_draw),
((pos_x,pos_y,pos_z), (rot_x,rot_y,rot_z), (gaze_pos_x, gaze_pos_y, gaze_pos_z), (gaze_rot_x, gaze_rot_y, gaze_rot_z), datetime, should_draw),
...
]
"""
conversion_rate = 100.0


rs.scriptcontext.doc = rs.Rhino.RhinoDoc.ActiveDoc

if should_draw == True:
    b_is_valid = True if head_point_b != None else False
    is_past_gui_test = head_point_a[4]
    #s_past_gui_test = True if compare_datetimes() else False
    
    if b_is_valid and is_past_gui_test:
        a_x = head_point_a[0][0] / conversion_rate
        a_y = head_point_a[0][1] / conversion_rate
        a_z = head_point_a[0][2] / conversion_rate
        
        b_x = head_point_b[0][0] / conversion_rate
        b_y = head_point_b[0][1] / conversion_rate
        b_z = head_point_b[0][2] / conversion_rate
        
        pos_a = [a_x, a_y, a_z]
        pos_b = [b_x, b_y, b_z]
        
        line = rs.AddLine(pos_a,pos_b)
        rs.ObjectColor(line, line_color)
        rs.ObjectLayer(line, path_layer_name)
# ---------- end graph_head_data ----------
# Y
rot3d_5 = Rotate3D(Geometry=rot3d_4.Geometry, Angle=rad_8, Center=end.Start, Axis=vec_12.Vector)  # -> Geometry, Transform
# Z
rot3d_6 = Rotate3D(Geometry=rot3d_5.Geometry, Angle=rad_9, Center=end.Start, Axis=vec_13.Vector)  # -> Geometry, Transform
range = Range(Domain=dom, Steps=subtraction_4)
# Rotate
devec_4 = DeconstructVector(Vector=relay_3)  # -> XComponent, YComponent, ZComponent
item_6 = ListItem(List=line_4, Index=range, Wrap=Toggle(False))
rad_10 = Radians(Degrees=devec_4.YComponent)
rot3d_7 = Rotate3D(Geometry=srf4pt_2, Angle=rad_10, Center=pt_5, Axis=Vector(0, 0, 1))  # -> Geometry, Transform
panel_28 = Panel(graph_head_data)
pdecon_7 = Deconstruct(Point=get_head_data.wall_rotation)  # -> XComponent, YComponent, ZComponent
rad_11 = Radians(Degrees=pdecon_7.XComponent)
rad_12 = Radians(Degrees=pdecon_7.YComponent)
rad_13 = Radians(Degrees=pdecon_7.ZComponent)
panel_30 = Panel("Z Axis (Rhino)")
# Create material
gradient_2 = Gradient(
    LowerLimit="0",
    UpperLimit=panel_26,
    Parameter=range,
    stops=[0: RGB(255, 0, 0), 0.254: RGB(255, 192, 192), 0.497: RGB(255, 255, 255), 0.751: RGB(192, 192, 255), 1: RGB(0, 0, 255)])
subtraction_5 = Subtraction(A="180", B=devec_4.YComponent)
vec_14 = VectorXYZ(XComponent="1", YComponent="0", ZComponent="0")  # -> Vector, Length
vec_15 = VectorXYZ(XComponent="0", YComponent="1", ZComponent="0")  # -> Vector, Length
vec_16 = VectorXYZ(XComponent="0", YComponent="0", ZComponent="1")  # -> Vector, Length
rad_14 = Radians(Degrees=subtraction_5)
vec_17 = VectorXYZ(XComponent="0", YComponent="0", ZComponent="1")  # -> Vector, Length
swatch_3 = ColourSwatch(SwatchColor=RGB(230, 234, 255))
# X
head_pos_4 = Rotate3D(Geometry=move.Geometry, Angle=rad_11, Center=end.Start, Axis=vec_14.Vector)  # -> Geometry, Transform
menu_pos = Rotate3D(Geometry=move_2.Geometry, Angle=rad_11, Center=end.Start, Axis=vec_14.Vector)  # -> Geometry, Transform
head_rot_4 = Rotate(Vector=eulertovec_unity.vector, Axis=vec_14.Vector, Angle=rad_11)
gaze_rot_4 = Rotate(Vector=get_head_data.gaze_rotations, Axis=vec_14.Vector, Angle=rad_11)
menu_rot = Rotate(Vector=eulertovec_unity_2.vector, Axis=vec_14.Vector, Angle=rad_11)
# Y
head_pos_5 = Rotate3D(Geometry=head_pos_4.Geometry, Angle=rad_12, Center=end.Start, Axis=vec_15.Vector)  # -> Geometry, Transform
# Z
head_pos_6 = Rotate3D(Geometry=head_pos_5.Geometry, Angle=rad_13, Center=end.Start, Axis=vec_16.Vector)  # -> Geometry, Transform
menu_pos_2 = Rotate3D(Geometry=menu_pos.Geometry, Angle=rad_12, Center=end.Start, Axis=vec_15.Vector)  # -> Geometry, Transform
head_rot_5 = Rotate(Vector=head_rot_4, Axis=vec_15.Vector, Angle=rad_12)
gaze_rot_5 = Rotate(Vector=gaze_rot_4, Axis=vec_15.Vector, Angle=rad_12)
menu_pos_3 = Rotate3D(Geometry=menu_pos_2.Geometry, Angle=rad_13, Center=end.Start, Axis=vec_16.Vector)  # -> Geometry, Transform
head_rot_6 = Rotate(Vector=head_rot_5, Axis=vec_16.Vector, Angle=rad_13)
gaze_rot_6 = Rotate(Vector=gaze_rot_5, Axis=vec_16.Vector, Angle=rad_13)
menu_rot_2 = Rotate(Vector=menu_rot, Axis=vec_15.Vector, Angle=rad_12)
menu_rot_3 = Rotate(Vector=menu_rot_2, Axis=vec_16.Vector, Angle=rad_13)
rot3d_8 = Rotate3D(Geometry=item_6, Angle=rad_14, Center=Point(0, 0, 0), Axis=vec_17.Vector)  # -> Geometry, Transform
rot3d_9 = Rotate3D(Geometry=rot3d_7.Geometry, Angle=rad_14, Center=Point(0, 0, 0), Axis=vec_17.Vector)  # -> Geometry, Transform
rot3d_10 = Rotate3D(Geometry=vec.Vector, Angle=rad_14, Center=Point(0, 0, 0), Axis=vec_17.Vector)  # -> Geometry, Transform
# Rotate facade and points to correct orientation
panel_31 = Panel("X Axis")
vec_18 = VectorXYZ(XComponent="1", YComponent="0", ZComponent="0")  # -> Vector, Length
rad_15 = Radians(Degrees=devec_4.XComponent)
end_2 = EndPoints(Curve=head_pos_6.Geometry)  # -> Start, End
lng_6 = ListLength(List=end_2.End)
rot3d_11 = Rotate3D(Geometry=rot3d_8.Geometry, Angle=rad_15, Center=Point(0, 0, 0), Axis=vec_18.Vector)  # -> Geometry, Transform
rot3d_12 = Rotate3D(Geometry=rot3d_9.Geometry, Angle=rad_15, Center=Point(0, 0, 0), Axis=vec_18.Vector)  # -> Geometry, Transform
rot3d_13 = Rotate3D(Geometry=rot3d_10.Geometry, Angle=rad_15, Center=Point(0, 0, 0), Axis=vec_18.Vector)  # -> Geometry, Transform
subtraction_6 = Subtraction(A=lng_6, B="1")
# HEAD POS POINTS
# HEAD POS LINE
# HEAD ROT
item_7 = ListItem(List=end_2.End, Index=subtraction_6, Wrap=True)
merge = Merge(Data1=end_2.Start, Data2=item_7)
# Rotate/Re-position All
panel_32 = Panel("Y Axis (Rhino)")
subtraction_7 = Subtraction(A="180", B=devec_4.ZComponent)
# EYE ROT
# MENU POS POINTS
# MENU ROT
display_filter_view = GhPythonScript(view_type=list, head_line=head_pos_6.Geometry, head_rot=head_rot_6, gaze_rot=gaze_rot_6)  # -> out, out_head_line, out_head_rot, out_gaze_rot
# ---------- display_filter_view: Python ----------
__author__ = "jsermari"
__version__ = "2023.02.03"

import rhinoscriptsyntax as rs
import Rhino

out_head_line = None
out_head_rot = None
out_gaze_rot = None

if view_type == 1:
    pass
elif view_type == 2:
    out_gaze_rot = gaze_rot
elif view_type == 3:
    out_head_rot = head_rot
elif view_type == 4:
    if(head_line.ToString() != "00000000-0000-0000-0000-000000000000"):
        out_head_line = head_line
    else:
        out_head_line = None
elif view_type == 5:
    out_gaze_rot = gaze_rot
    out_head_rot = head_rot
elif view_type == 6:
    out_gaze_rot = gaze_rot
    if(head_line.ToString() != "00000000-0000-0000-0000-000000000000"):
        out_head_line = head_line
    else:
        out_head_line = None
elif view_type == 7:
    out_head_rot = head_rot
    if(head_line.ToString() != "00000000-0000-0000-0000-000000000000"):
        out_head_line = head_line
    else:
        out_head_line = None
elif view_type == 8:
    if(head_line.ToString() != "00000000-0000-0000-0000-000000000000"):
        out_head_line = head_line
    else:
        out_head_line = None
    out_head_rot = head_rot
    out_gaze_rot = gaze_rot
# ---------- end display_filter_view ----------
vec_19 = VectorXYZ(XComponent="0", YComponent="1", ZComponent="0")  # -> Vector, Length
rad_16 = Radians(Degrees=subtraction_7)
rot3d_14 = Rotate3D(Geometry=rot3d_11.Geometry, Angle=rad_16, Center=Point(0, 0, 0), Axis=vec_19.Vector)  # -> Geometry, Transform
rot3d_15 = Rotate3D(Geometry=rot3d_13.Geometry, Angle=rad_16, Center=Point(0, 0, 0), Axis=vec_19.Vector)  # -> Geometry, Transform
rot3d_16 = Rotate3D(Geometry=rot3d_12.Geometry, Angle=rad_16, Center=Point(0, 0, 0), Axis=vec_19.Vector)  # -> Geometry, Transform
# Menu is visible now
item_8 = ListItem(List=get_head_data.menu_visibles, Index=round_3.Nearest, Wrap=True)
and = GateAnd(A=show_highlight, B=item_8)
# Start point
startpoint_2 = Slider(0, range=0..10000)
panel_33 = Panel("Display")
panel_34 = Panel("HEAD POS")
panel_35 = Panel("HEAD ROT")
panel_36 = Panel("MENU")
panel_37 = Panel("GAZE ROT")
panel_38 = Panel("MENU POS")
panel_39 = Panel("MENU ROT")
# End point
lng_7 = ListLength(List=head_pos_6.Geometry)
item_9 = ListItem(List=menu_pos_3.Geometry, Index=round_3.Nearest, Wrap=True)
item_10 = ListItem(List=merge, Index=round_3.Nearest, Wrap=True)
item_11 = ListItem(List=head_rot_6, Index=round_3.Nearest, Wrap=True)
item_12 = ListItem(List=gaze_rot_6, Index=round_3.Nearest, Wrap=True)
item_13 = ListItem(List=menu_rot_3, Index=round_3.Nearest, Wrap=True)
# Base scale
item_14 = ListItem(List=get_head_data.menu_scales, Index=round_3.Nearest, Wrap=True)
# Base rotation
item_15 = ListItem(List=menu_rot_3, Index=round_3.Nearest, Wrap=True)
# Base position
item_16 = ListItem(List=menu_pos_3.Geometry, Index=round_3.Nearest, Wrap=True)
pdecon_8 = Deconstruct(Point=item_14)  # -> XComponent, YComponent, ZComponent
dom_2 = ConstructDomain(DomainStart=startpoint_2, DomainEnd=lng_7)
subtraction_8 = Subtraction(A=lng_7, B=startpoint_2)
range_2 = Range(Domain=dom_2, Steps=subtraction_8)
# Highlight
showif = GhPythonScript(show=and, geom=flatten(item_9))  # -> out, out_geom
# ---------- showif: Python ----------
__author__ = "jsermari"
__version__ = "2023.02.07"

import rhinoscriptsyntax as rs

out_geom = None
if show:
    out_geom = geom
# ---------- end showif ----------
# Highlight
# Full
showif_2 = GhPythonScript(show=show_highlight, geom=flatten(item_10))  # -> out, out_geom; same code as showif
pl_6 = PlaneNormal(Origin=item_16, ZAxis=item_15)
# Highlight
# Full
showif_3 = GhPythonScript(show=show_highlight, geom=flatten(item_11))  # -> out, out_geom; same code as showif
# Highlight
# Highlight
showif_4 = GhPythonScript(show=show_highlight, geom=flatten(item_12))  # -> out, out_geom; same code as showif
# Highlight
showif_5 = GhPythonScript(show=and, geom=flatten(item_13))  # -> out, out_geom; same code as showif
# Full
gradient_3 = Gradient(
    LowerLimit=startpoint_2,
    UpperLimit=lng_7,
    Parameter=range_2,
    stops=[0: RGB(255, 0, 0), 0.254: RGB(255, 192, 192), 0.497: RGB(255, 255, 255), 0.751: RGB(192, 192, 255), 1: RGB(0, 0, 255)])
planesrf = PlaneSurface(Plane=pl_6, XSize=pdecon_8.XComponent, YSize=pdecon_8.YComponent)
gradient_4 = Gradient(LowerLimit=startpoint_2, UpperLimit=lng_7, Parameter=range_2, stops=[0: RGB(255, 0, 0), 1: RGB(72, 209, 204)])
number_slider_6 = Slider(1, range=0..1)
number_slider_7 = Slider(0.279, range=0..1)
area = Area(Geometry=planesrf)  # -> Area, Centroid
swatch_4 = ColourSwatch(SwatchColor=RGB(255, 105, 105))
# Re-center
vec2pt_3 = Vector2Pt(PointA=area.Centroid, PointB=item_16, Unitize=False)  # -> Vector, Length
vdisex_7 = VectorDisplayEx(Point=menu_pos_3.Geometry, Vector=menu_rot_3, Colour=swatch_4, Width=Slider(0.5, range=0.5..3))
vdisex_8 = VectorDisplayEx(Point=merge, Vector=display_filter_view.out_head_rot, Colour=head_color, Width=Slider(0.5, range=0.5..3))
dots = DotDisplay(Point=showif.out_geom, Colour=swatch_4, Size=Slider(0.176, range=0..1))
dots_2 = DotDisplay(Point=showif_2.out_geom, Colour=head_pos_color, Size=Slider(0.067, range=0..1))
vdisex_9 = VectorDisplayEx(Point=item_10, Vector=showif_3.out_geom, Colour=head_color_2, Width=Slider(2.35, range=0.5..3))
vdisex_10 = VectorDisplayEx(Point=merge, Vector=display_filter_view.out_gaze_rot, Colour=eye_color, Width=Slider(0.5, range=0.5..3))
dots_3 = DotDisplay(Point=menu_pos_3.Geometry, Colour=swatch_4, Size=Slider(0.03, range=0..0.5))
vdisex_11 = VectorDisplayEx(Point=item_10, Vector=showif_4.out_geom, Colour=eye_color_2, Width=Slider(3, range=0.5..3))
vdisex_12 = VectorDisplayEx(Point=item_9, Vector=showif_5.out_geom, Colour=swatch_4, Width=Slider(3, range=0.5..3))
move_3 = Move(Geometry=planesrf, Motion=vec2pt_3.Vector)  # -> Geometry, Transform
demesh = DeconstructMesh(Mesh=rot3d_16.Geometry)  # -> Vertices, Faces, Colours, Normals
vec_20 = VectorXYZ(XComponent="0", YComponent="0", ZComponent="0.01")  # -> Vector, Length
# Get translation vector
item_17 = ListItem(List=demesh.Vertices, Index=Slider(2, range=0..3), Wrap=True)
extr = Extrude(Base=head_pos_6.Geometry, Direction=vec_20.Vector)
preview = CustomPreview(Geometry=extr, Material=gradient_4)
vec2pt_4 = Vector2Pt(PointA=item_17, PointB=relay, Unitize=False)  # -> Vector, Length
vdis_12 = VectorDisplay(Anchor=item_17, Vector=vec2pt_4.Vector)  # disabled
# Translate points/facade
move_4 = Move(Geometry=rot3d_14.Geometry, Motion=vec2pt_4.Vector)  # -> Geometry, Transform
move_5 = Move(Geometry=rot3d_16.Geometry, Motion=vec2pt_4.Vector)  # -> Geometry, Transform
vec_21 = VectorXYZ(XComponent="3.051", YComponent="0", ZComponent="2.651")  # -> Vector, Length
head_lines = Move(Geometry=move_4.Geometry, Motion=vec_21.Vector)  # -> Geometry, Transform
facade = Move(Geometry=move_5.Geometry, Motion=vec_21.Vector)  # -> Geometry, Transform
# Visualize
panel_40 = Panel("")
unit = UnitVector(Vector=rot3d_15.Geometry)
lng_8 = ListLength(List=head_lines.Geometry)
subtraction_9 = Subtraction(A=lng_8, B=startpoint)
dom_3 = ConstructDomain(DomainStart=startpoint, DomainEnd=lng_8)
range_3 = Range(Domain=dom_3, Steps=subtraction_9)
cull_i_3 = CullIndex(List=range_3, Indices="-1", Wrap=True)
end_3 = EndPoints(Curve=head_lines.Geometry)  # -> Start, End
item_18 = ListItem(List=unit, Index=cull_i_3, Wrap=True)
preview_2 = CustomPreview(Geometry=head_lines.Geometry, Material=gradient_2)
vdis_13 = VectorDisplay(Anchor=end_3.Start, Vector=item_18)
